# Grasshopper definition AIAstudio_furniture Copilot_prompt.gh (Grasshopper 1.0.8)

python_3_script = Python3Script(prompt="I work from 9am to 5pm and do yoga at 9pm")  # -> activities_json, activities, hours
# ---------- python_3_script: Python ----------
import ghpythonremote
ghpythonremote.connect()

import requests
import json

url = "http://127.0.0.1:5000/extract_activities"

try:
    r = requests.post(url, json={"prompt": prompt})
    r.raise_for_status()
    activities_json = r.json()["activities"]
    activities = json.loads(activities_json)
    hours = [a["hours"] for a in activities]
except Exception as e:
    activities_json = str(e)
    activities = []
    hours = []
# ---------- end python_3_script ----------
