# Grasshopper definition prompt.gh (Grasshopper 1.0.8)
# plug-ins: RhinoCodePluginGH

panel = Panel("i work from 8am to 4pm then i sit and read my book at 6pm to 8pm and do yoga at 9pm and i slpeep from 11pm until 7am ")
run = Button()
python_3_script = Python3Script(prompt=panel, run=run)  # -> out, hourly_metabolic_rates, hourly_activities, activities_json_str
# ---------- python_3_script: Python ----------
import requests
import json

url = "http://127.0.0.1:5000/extract_activities"

try:
    r = requests.post(url, json={"prompt": prompt})
    r.raise_for_status()
    result = r.json()
    print("RESULT FROM SERVER:", result)

    activities_data = result["activities"]

    hourly_metabolic_rates = list(activities_data["hourly_metabolic_rates"])
    hourly_activities = list(activities_data["hourly_activities"])
    activities_json_str = json.dumps(activities_data["activities_json"], indent=2)
except Exception as e:
    hourly_metabolic_rates = []
    hourly_activities = []
    activities_json_str = str(e)

a = hourly_metabolic_rates
b = hourly_activities
c = activities_json_str
# ---------- end python_3_script ----------
panel_2 = Panel(python_3_script.activities_json_str)
metabolic_rates = Panel(python_3_script.hourly_metabolic_rates)
activities = Panel(python_3_script.hourly_activities)
